# Grasshopper definition final stair.gh (Grasshopper 1.0.8)

no_of_treads = Slider(26, range=0..100)
construct_point = ConstructPoint(XCoordinate=0, YCoordinate=0, ZCoordinate=0)
inside_diameter = Slider(2400, range=0..2500)
division = Division(A=no_of_treads, B="5")
point = Point(construct_point)
treads_for_landing = Slider(4, range=0..10)
division_2 = Division(A=inside_diameter, B=2)
stair_width = Slider(1200, range=0..1200)
circle = Circle(Plane=point, Radius=division_2)
division_3 = Division(A="360", B=no_of_treads)
division_4 = Division(A="360", B=division)
addition = Addition(A=no_of_treads, B=1)
subtraction = Subtraction(A=treads_for_landing, B=1)
offset_curve = OffsetCurve(Curve=circle, Distance=stair_width, Corners=1)
end_points = EndPoints(Curve=circle)  # -> Start, End
series = Series(Start=0, Step=division_3, Count=addition)
boundary_surfaces = BoundarySurfaces(Edges=flatten([circle, offset_curve]))
end_points_2 = EndPoints(Curve=offset_curve)  # -> Start, End
subtraction_2 = Subtraction(A=no_of_treads, B=subtraction)
line = Line(StartPoint=end_points.Start, EndPoint=end_points_2.Start)
tread_height = Slider(200, range=0..1000)
addition_2 = Addition(A=subtraction_2, B=1)
rotate = Rotate(Geometry=end_points_2.Start, Angle=degrees(series), Plane=point)  # -> Geometry, Transform
unit_z = UnitZ(Factor=tread_height)
series_2 = Series(Start=0, Step=division_3, Count=addition)
series_3 = Series(Start=0, Step=tread_height, Count=addition_2)
end_points_3 = EndPoints(Curve=line)  # -> Start, End
move = Move(Geometry=line, Motion=unit_z)  # -> Geometry, Transform
unit_z_2 = UnitZ(Factor=series_3)
move_2 = Move(Geometry=rotate.Geometry, Motion=unit_z_2)  # -> Geometry, Transform
unit_z_3 = UnitZ(Factor=Slider(378, range=0..1000))
point_2 = Point(end_points_3.Start)
end_points_4 = EndPoints(Curve=move.Geometry)  # -> Start, End
rotate_2 = Rotate(Geometry=point_2, Angle=degrees(series_2), Plane=PlaneXY(0, 0, 0))  # -> Geometry, Transform
nurbs_curve = NurbsCurve(Vertices=move_2.Geometry, Degree=3, Periodic=False)  # -> Curve, Length, Domain
number_slider = Slider(900, range=0..900)
move_3 = Move(Geometry=rotate_2.Geometry, Motion=unit_z_2)  # -> Geometry, Transform
unit_z_4 = UnitZ(Factor=tread_height)
move_4 = Move(Geometry=end_points_4.End, Motion=unit_z_3)  # -> Geometry, Transform
move_5 = Move(Geometry=end_points_4.Start, Motion=unit_z_3)  # -> Geometry, Transform
unit_z_5 = UnitZ(Factor=number_slider)
move_6 = Move(Geometry=move_3.Geometry, Motion=unit_z_5)  # -> Geometry, Transform
unit_z_6 = UnitZ(Factor=number_slider)
move_7 = Move(Geometry=move_2.Geometry, Motion=unit_z_5)  # -> Geometry, Transform
list_item = ListItem(List=move_6.Geometry, Index=0, Wrap=True)
number_slider_2 = Slider(200, range=0..1000)
number_slider_3 = Slider(2, range=0..10)
interpolate = Interpolate(Vertices=move_6.Geometry, Degree=3, Periodic=False, KnotStyle=1)  # -> Curve, Length, Domain
list_item_2 = ListItem(List=move_7.Geometry, Index=0, Wrap=True)
move_8 = Move(Geometry=list_item, Motion=unit_z_4)  # -> Geometry, Transform
move_9 = Move(Geometry=list_item_2, Motion=unit_z_4)  # -> Geometry, Transform
subtraction_3 = Subtraction(A=no_of_treads, B=treads_for_landing)
nurbs_curve_2 = NurbsCurve(
    Vertices=[list_item_2, move_4.Geometry, end_points_4.End, end_points_4.Start, move_5.Geometry, list_item],
    Degree=number_slider_3,
    Periodic=False)  # -> Curve, Length, Domain
addition_3 = Addition(A=subtraction_3, B="1")
negative = Negative(Value=number_slider_2)
unit_x = UnitX(Factor=1)
subtraction_4 = Subtraction(A=division_3, B=Slider(1.617, range=0..10))
series_4 = Series(Start=0, Step=tread_height, Count=subtraction_2)
nurbs_curve_3 = NurbsCurve(
    Vertices=[move_9.Geometry, move_4.Geometry, end_points_4.End, end_points_4.Start, move_5.Geometry, move_8.Geometry],
    Degree=number_slider_3,
    Periodic=False)  # -> Curve, Length, Domain
multiplication = Multiplication(A=tread_height, B=addition_3)
interpolate_2 = Interpolate(Vertices=move_7.Geometry, Degree=3, Periodic=False, KnotStyle=1)  # -> Curve, Length, Domain
division_5 = Division(A=number_slider_2, B="2")
end_points_5 = EndPoints(Curve=interpolate.Curve)  # -> Start, End
offset_curve_2 = OffsetCurve(Curve=interpolate.Curve, Distance=negative, Plane=unit_x, Corners=1)
negative_2 = Negative(Value=Slider(900, range=0..900))
unit_z_7 = UnitZ(Factor=division_5)
rotate_3 = Rotate(Geometry=nurbs_curve_3.Curve, Angle=degrees(subtraction_4), Plane=PlaneXY(0, 0, 0))  # -> Geometry, Transform
unit_z_8 = UnitZ(Factor=series_4)
rotate_4 = Rotate(Geometry=nurbs_curve_2.Curve, Angle=degrees(series), Plane=PlaneXY(0, 0, 0))  # -> Geometry, Transform
offset_curve_3 = OffsetCurve(Curve=interpolate_2.Curve, Distance=number_slider_2, Plane=unit_x, Corners=1)
end_points_6 = EndPoints(Curve=interpolate_2.Curve)  # -> Start, End
unit_z_9 = UnitZ(Factor=negative_2)
series_5 = Series(Start=0, Step=division_4, Count=division)
end_points_7 = EndPoints(Curve=offset_curve_2)  # -> Start, End
addition_4 = Addition(A=end_points_7.Start, B=end_points_5.Start)
division_6 = Division(A=addition_4, B="2")
end_points_8 = EndPoints(Curve=offset_curve_3)  # -> Start, End
rotate_5 = Rotate(Geometry=rotate_3.Geometry, Angle=degrees(series), Plane=PlaneXY(0, 0, 0))  # -> Geometry, Transform
negative_3 = Negative(Value=number_slider_2)
addition_5 = Addition(A=end_points_6.Start, B=end_points_8.Start)
move_10 = Move(Geometry=division_6, Motion=unit_z_7)  # -> Geometry, Transform
multiplication_2 = Multiplication(A=number_slider_2, B="2")
move_11 = Move(Geometry=offset_curve_2, Motion=unit_z_9)  # -> Geometry, Transform
move_12 = Move(Geometry=offset_curve_3, Motion=unit_z_9)  # -> Geometry, Transform
move_13 = Move(Geometry=rotate_4.Geometry, Motion=unit_z_8)  # -> Geometry, Transform
xy_plane = XYPlane(Origin=Point(0, 0, 0))
offset_curve_4 = OffsetCurve(Curve=circle, Distance=negative_3, Corners=1)
division_7 = Division(A=addition_5, B="2")
division_8 = Division(A=number_slider_2, B="2")
extrude = Extrude(Base=offset_curve_2, Direction=unit_z_9)
extrude_2 = Extrude(Base=offset_curve_3, Direction=unit_z_9)
panel = Panel("""50
51
52
53
53""")
move_14 = Move(Geometry=rotate_5.Geometry, Motion=unit_z_8)  # -> Geometry, Transform
unit_z_10 = UnitZ(Factor=division_8)
end_points_9 = EndPoints(Curve=move_11.Geometry)  # -> Start, End
end_points_10 = EndPoints(Curve=move_12.Geometry)  # -> Start, End
divide_curve = DivideCurve(Curve=offset_curve_4, Count=10, Kinks=False)  # -> Points, Tangents, Parameters
offset_curve_5 = OffsetCurve(Curve=offset_curve, Distance=number_slider_2, Corners=1)
arc_3pt = Arc3Pt(PointA=end_points_7.Start, PointB=move_10.Geometry, PointC=end_points_5.Start)  # -> Arc, Plane, Radius
addition_6 = Addition(A=stair_width, B=multiplication_2)
division_9 = Division(A=addition_6, B="2")
move_15 = Move(Geometry=division_7, Motion=unit_z_10)  # -> Geometry, Transform
addition_7 = Addition(A=end_points_10.Start, B=end_points_9.Start)
cull_index = CullIndex(List=move_13.Geometry, Indices=panel, Wrap=True)
divide_curve_2 = DivideCurve(Curve=offset_curve_5, Count=10, Kinks=False)  # -> Points, Tangents, Parameters
weave = Weave(Pattern=[0, 1], Stream0=cull_index, Stream1=move_14.Geometry, NullGaps=False)
end_points_11 = EndPoints(Curve=weave)  # -> Start, End
geometry = Geometry(end_points_11.End)
addition_8 = Addition(A=end_points_10.End, B=end_points_9.End)
pull_point = PullPoint(Point=geometry, Geometry=interpolate.Curve, ClosestOnly=True)  # -> ClosestPoint, Distance
list_item_3 = ListItem(List=divide_curve.Points, Index="0", Wrap=True)
panel_2 = Panel("""2
3
4
5
6
7
8
9
10""")
negative_4 = Negative(Value=division_9)
unit_z_11 = UnitZ(Factor=negative_4)
division_10 = Division(A=addition_7, B="2")
sweep2 = Sweep2(Rail1=interpolate.Curve, Rail2=offset_curve_2, Sections=arc_3pt.Arc, SameHeight=False)
line_2 = Line(StartPoint=end_points_7.Start, EndPoint=end_points_9.Start)
division_11 = Division(A=addition_8, B="2")
panel_3 = Panel(cull_index)
move_16 = Move(Geometry=division_10, Motion=unit_z_11)  # -> Geometry, Transform
negative_5 = Negative(Value=pull_point.Distance)
list_item_4 = ListItem(List=divide_curve_2.Points, Index=panel_2, Wrap=True)
arc_3pt_2 = Arc3Pt(PointA=end_points_6.Start, PointB=move_15.Geometry, PointC=end_points_8.Start)  # -> Arc, Plane, Radius
move_17 = Move(Geometry=division_11, Motion=unit_z_11)  # -> Geometry, Transform
unit_z_12 = UnitZ(Factor=multiplication)
line_3 = Line(StartPoint=end_points_8.Start, EndPoint=end_points_10.Start)
multiplication_3 = Multiplication(A=tread_height, B="5")
extend_curve = ExtendCurve(Curve=weave, Type=0, Start=negative_5, End=negative_5)
interpolate_3 = Interpolate(Vertices=flatten([list_item_3, list_item_4]), Degree=3, Periodic=False, KnotStyle=1)  # -> Curve, Length, Domain
number_slider_4 = Slider(10000, range=0..10000)
circle_2 = Circle(Plane=xy_plane, Radius=number_slider_4)
loft = Loft(
    Curves=flatten([circle_2, offset_curve_5]),
    Options={Adjust=False, Closed=False, LoftEnds=0, LoftSimp=0, LoftType=0, Rebuild=10, Refit=0.01})
arc_3pt_3 = Arc3Pt(PointA=end_points_10.Start, PointB=move_16.Geometry, PointC=end_points_9.Start)  # -> Arc, Plane, Radius
line_4 = Line(StartPoint=end_points_10.Start, EndPoint=end_points_9.Start)
sweep2_2 = Sweep2(Rail1=offset_curve_3, Rail2=offset_curve_2, Sections=arc_3pt_2.Arc, SameHeight=False)
arc_3pt_4 = Arc3Pt(PointA=end_points_10.End, PointB=move_17.Geometry, PointC=end_points_9.End)  # -> Arc, Plane, Radius
series_6 = Series(Start=0, Step=multiplication_3, Count=division)
cull_index_2 = CullIndex(List=extend_curve, Indices="-1", Wrap=True)
end_points_12 = EndPoints(Curve=interpolate_3.Curve)  # -> Start, End
negative_6 = Negative(Value=Slider(300, range=0..300))
unit_z_13 = UnitZ(Factor=negative_6)
rotate_6 = Rotate(Geometry=arc_3pt_3.Arc, Angle=degrees(series_5), Plane=PlaneXY(0, 0, 0))  # -> Geometry, Transform
line_5 = Line(StartPoint=end_points_12.Start, EndPoint=end_points_12.End)
loft_2 = Loft(Curves=cull_index_2, Options={Adjust=False, Closed=False, LoftEnds=0, LoftSimp=0, LoftType=2, Rebuild=10, Refit=0.01})
unit_z_14 = UnitZ(Factor=series_6)
cylinder = Cylinder(Base=PlaneXY(0, 0, 0), Radius=number_slider_4, Length=negative_6)
join_curves = JoinCurves(Curves=[line_5, interpolate_3.Curve], Preserve=False)
join_curves_2 = JoinCurves(Curves=flatten([nurbs_curve_2.Curve, arc_3pt_2.Arc, line_3, line_2, arc_3pt.Arc, line_4]), Preserve=False)
move_18 = Move(Geometry=rotate_6.Geometry, Motion=unit_z_14)  # -> Geometry, Transform
sweep2_3 = Sweep2(Rail1=move_12.Geometry, Rail2=move_11.Geometry, Sections=[move_18.Geometry, arc_3pt_4.Arc], SameHeight=False)
boundary_surfaces_2 = BoundarySurfaces(Edges=flatten([join_curves, circle_2]))
extrude_3 = Extrude(Base=boundary_surfaces_2, Direction=unit_z_13)
move_19 = Move(Geometry=extrude_3, Motion=unit_z_12)  # -> Geometry, Transform
cap_holes = CapHoles(Brep=cylinder)
patch = Patch(Curves=join_curves_2, Spans=20, Flexibility=1, Trim=True)
end_points_13 = EndPoints(Curve=move_18.Geometry)  # -> Start, End
curve_middle = CurveMiddle(Curve=move_18.Geometry)
cull_index_3 = CullIndex(List=move_18.Geometry, Indices="0", Wrap=True)
move_20 = Move(Geometry=end_points_13.Start, Motion=unit_z_5)  # -> Geometry, Transform
move_21 = Move(Geometry=end_points_13.End, Motion=unit_z_5)  # -> Geometry, Transform
split_brep = SplitBrep(Brep=sweep2_3, Cutter=cap_holes)
project_point = ProjectPoint(Point=curve_middle, Direction=Vector(0, 0, -1), Geometry=cap_holes)  # -> Point, Index
line_6 = Line(StartPoint=move_20.Geometry, EndPoint=end_points_13.Start)
line_7 = Line(StartPoint=move_21.Geometry, EndPoint=end_points_13.End)
line_8 = Line(StartPoint=curve_middle, EndPoint=project_point.Point)
list_item_5 = ListItem(List=split_brep, Index="1", Wrap=True)
brep_join = BrepJoin(Breps=flatten([patch, sweep2_2, loft_2, list_item_5, extrude_2, extrude, sweep2]))  # -> Breps, Closed
deconstruct_brep = DeconstructBrep(Brep=brep_join.Breps)  # -> Faces, Edges, Vertices
curve = Curve(deconstruct_brep.Edges)
evaluate_length = EvaluateLength(Curve=curve, Length=0.5, Normalized=True)  # -> Point, Tangent, Parameter
cull_index_4 = CullIndex(List=line_7, Indices="0", Wrap=True)
cull_index_5 = CullIndex(List=line_6, Indices="0", Wrap=True)
curve_closest_point = CurveClosestPoint(Point=evaluate_length.Point, Curve=join_curves_2)  # -> Point, Parameter, Distance
panel_4 = Panel(curve_closest_point.Distance)
pipe = Pipe(Curve=[line_8, cull_index_3, cull_index_4, cull_index_5], Radius=Slider(50, range=0..70), Caps=0)
cap_holes_2 = CapHoles(Brep=pipe)
